# Grasshopper definition 131105_DynamicRelaxation_pn.gh (Grasshopper 0.9.61)
# plug-ins: Python Interpreter

second_moment_of_area = Slider(0.25, range=0..1)
second_moment_of_area_2 = Slider(0.25, range=0..1)
# MATERIALS
second_moment_of_area_3 = Slider(0.25, range=0..1)
e_value = Slider(1796.982, range=0..2500)
e_value_2 = Slider(2500, range=0..2500)
e_value_3 = Slider(1834.457, range=0..2500)
s_value = Slider(0.25, range=0..1)
s_value_2 = Slider(0.25, range=0..1)
s_value_3 = Slider(0.25, range=0..1)
path_mapper = PathMapper(["MATERIAL ONE", e_value_3, second_moment_of_area_3, s_value_3], source="{0}", target="{0}")
path_mapper_2 = PathMapper(["MATERIAL THREE", e_value_2, second_moment_of_area_2, s_value_2], source="{0}", target="{2}")
path_mapper_3 = PathMapper(["MATERIAL TWO", e_value, second_moment_of_area, s_value], source="{0}", target="{1}")

# ----
# Bending Materials
# Elastics Materials
# Cable Materials
panel = Panel("MATERIAL THREE")
# ELEMENTS
panel_2 = Panel("MATERIAL ONE")
crv = Curve([<curve referenced from the Rhino model> x4])
crv_2 = Curve([<curve referenced from the Rhino model> x4])
crv_3 = Curve([<curve referenced from the Rhino model> x3])
crv_4 = Curve([<curve referenced from the Rhino model> x4])
path_mapper_4 = PathMapper([crv, panel], source="{0}", target="{0}")
path_mapper_5 = PathMapper([crv_2, "MATERIAL FOUR"], source="{0}", target="{0}")
path_mapper_6 = PathMapper([crv_4, panel_2], source="{0}", target="{0}")
path_mapper_7 = PathMapper([crv_3, "MATERIAL TWO"], source="{0}", target="{1}")

merge = Merge(Data1=path_mapper_6, Data2=path_mapper_7)
merge_2 = Merge(Data1=path_mapper, Data2=path_mapper_3, Data3=path_mapper_2)
run = BooleanToggle(True)
reset = BooleanToggle(False)
timer = Timer(TimerInterval=2, Target=dynamic_relaxation_engine)  # disabled
fixed_points = Point([Point(0, 15, 0), Point(-5, 15, 0), Point(-10, 15, 0), Point(-15, 15, 0), Point(-15, -15, 0), Point(-10, -15, 0), Point(-5, -15, 0), Point(0, -15, 0)])
step_size = Slider(1000, range=1..50000)
panel_3 = Panel(merge)

# ----
# LOADS
pt = Point([<point referenced from the Rhino model> x4])
newtons = Slider(2500, range=0..250000)
pt_2 = Point([<point referenced from the Rhino model> x4])
newtons_2 = Slider(2500, range=0..250000)
vec = VectorXYZ(XComponent=Slider(0, range=0..1), YComponent=Slider(0, range=0..1), ZComponent=Slider(1, range=0..1))  # -> Vector, Length
vec_2 = VectorXYZ(XComponent=Slider(0, range=0..1), YComponent=Slider(1, range=0..1), ZComponent=Slider(0, range=0..1))  # -> Vector, Length
line = LineSDL(Start=pt, Direction=vec.Vector, Length=newtons)
line_2 = LineSDL(Start=pt_2, Direction=vec_2.Vector, Length=newtons_2)
rev = Reverse(Vector=vec.Vector)
rev_2 = Reverse(Vector=vec_2.Vector)
vdis = VectorDisplay(Anchor=pt, Vector=rev)
vdis_2 = VectorDisplay(Anchor=pt_2, Vector=rev_2)

vec_3 = VectorXYZ(XComponent=newtons, YComponent=0, ZComponent=0)  # -> Vector, Length
vec_4 = VectorXYZ(XComponent=newtons_2, YComponent=0, ZComponent=0)  # -> Vector, Length

path_mapper_8 = PathMapper([pt_2, vec_2.Vector, vec_4.Vector], source="{0}", target="{1}")
path_mapper_9 = PathMapper([pt, vec.Vector, vec_3.Vector], source="{0}", target="{0}")

merge_3 = Merge(Data1=path_mapper_9, Data2=path_mapper_8)
dynamic_relaxation_engine = PythonScript(
    bendings=merge,
    elastics=path_mapper_4,
    cables=path_mapper_5,
    loads=merge_3,
    materials=merge_2,
    fixedPoints=fixed_points,
    run=run,
    reset=reset,
    step=step_size)  # -> out, bendingsOUT, elasticsOUT, cablesOUT, loadsOUT, fixedPointsOUT, particles; inputs bendings: tree, elastics: list, cables: list, loads: tree of Point3d, materials: tree, fixedPoints: list of Point3d
# ---------- dynamic_relaxation_engine: Python ----------
import Rhino # this is all the Rhino common classes and stuff (documentation here: http://4.rhino3d.com/5/rhinocommon/)
#import rhinoscriptsyntax as rs
import sys
import DynamicRelaxation
import rhinoscriptsyntax as rs
import System
import time

#-------------------------------------------------------------------------------
# Functions
#-------------------------------------------------------------------------------
def makePtFromRhino(pt):
    return DynamicRelaxation.Point3D(pt.X,pt.Y,pt.Z)

def makePtsFromRhino(pts):
    a = []
    for pt in pts:
        a.append(makePtFromRhino(pt))
    return a

#-------------------------------------------------------------------------------
# Initialisation
#-------------------------------------------------------------------------------
if reset :
    # create particle system no drag no gravity
    ps = DynamicRelaxation.ParticleSystem()
    allbendings = []

    # import materials
    matName = []
    matEval = []
    matMom = []
    matS = []
    for i in range(materials.BranchCount):
        matName.append (materials.Branch(i)[0])
        matEval.append (materials.Branch(i)[1])
        matMom.append (materials.Branch(i)[2])
        matS.append (materials.Branch(i)[3])

    #import curves
    bendItems = []
    for i in range(bendings.BranchCount):
        bendItems = []
        matSpec = bendings.Branch(i)[len(bendings.Branch(i))-1]
        for j in range(len(bendings.Branch(i))-1):
            bendItems.append(bendings.Branch(i)[j])
        for crv in bendItems:
            pts = rs.PolylineVertices(crv)
            #create the bending elements (registered automagically in ps)
            parts = DynamicRelaxation.makeBendingsFromList(ps, makePtsFromRhino(pts),matEval[matName.index(matSpec)],matMom[matName.index(matSpec)],matS[matName.index(matSpec)])
            #parts = DynamicRelaxation.makeBendingsFromList(ps, makePtsFromRhino(pts),28000e06,7e-09,2.01062e-04)
            # keep a copy for display of the particles making a bending line
            allbendings.append(parts)

    # fix particles at the end
    for pt in fixedPoints:
        ps.findParticleEqualToPoint(makePtFromRhino(pt)).makeFixed()

    # loads
    ptItems = []
    for i in range(loads.BranchCount):#iterate branches and pass loads to DR 
        for j in range(len(loads.Branch(i))-2):
            ptItems.append(loads.Branch(i)[j])
        dirItem = loads.Branch(i)[(len(loads.Branch(i))-2)]#get direction (vector) 
        forceItem = loads.Branch(i)[(len(loads.Branch(i))-1)][0]#get force (vector x value) 
        DynamicRelaxation.makeLoadsFromList(ps, makePtsFromRhino(ptItems), makePtFromRhino(dirItem), forceItem)

#-------------------------------------------------------------------------------
# Dynamic Relaxation step
#-------------------------------------------------------------------------------
if run:
    t0 = 0
    for i in range(10):
        #ps.step(step)
        #checking the time to take one iteration - currently just a touch over 0.3 seconds - ouch!!!!!
        t1 = time.clock() 
        print t1-t0
        ps.stepRelax(step)
        t0 = t1

#------------------------------------------------------------------------------
# Display functions
#-------------------------------------------------------------------------------
bendingsOUT = []

for b in allbendings:
    parts = []
    particles, bendings = b
    for p in particles:
        part = Rhino.Geometry.Point3d(p.position.x(), p.position.y(), p.position.z())
        parts.append(part)
    bendingsOUT.append(Rhino.Geometry.PolylineCurve(parts))

particles = []
for p in ps.particles:
    part = Rhino.Geometry.Point3d(p.position.x(), p.position.y(), p.position.z())
    particles.append(part)

loadsOUT = []
#for l in ps.loads:
#    part = Rhino.Geometry.Point3d(a)
#    loadsOUT.append(part)
# ---------- end dynamic_relaxation_engine ----------
crv_5 = Curve(dynamic_relaxation_engine.bendingsOUT)
pt_3 = Point(dynamic_relaxation_engine.particles)
panel_4 = Panel(crv_5)
