# Grasshopper definition 131108_DynamicRelaxation_pn.gh (Grasshopper 0.9.61)
# plug-ins: Python Interpreter

# ----
# LOADS
pt = Point([<point referenced from the Rhino model> x4])
newtons = Slider(2500, range=0..25000)
# MATERIALS
number_slider = Slider(0, range=-1..1)
# LOADS
# New loads are added in the same manner as described above. Remember to increase the target integer in the path mapper component to the next unique integer.
# 
# The point collection takes a point or points.  Set the force in newtons, and the vector X, Y and Z components.
pt_2 = Point([<point referenced from the Rhino model> x5])
x_axis_rotation = Slider(0, range=0..360)
y_axis_rotation = Slider(180, range=0..360)
z_axis_rotation = Slider(0, range=0..360)
newtons_2 = Slider(1680.328, range=0..25000)
vec = VectorXYZ(XComponent=newtons, YComponent=0, ZComponent=0)  # -> Vector, Length
vec_2 = VectorXYZ(XComponent=Slider(0, range=-1..1), YComponent=Slider(1, range=-1..1), ZComponent=number_slider)  # -> Vector, Length
cluster = Cluster(A=x_axis_rotation, G=pt_2, A_3=z_axis_rotation, A_2=y_axis_rotation, X=newtons_2, d3=pt_2)  # -> V, G_2, V_2, R
line = LineSDL(Start=pt, Direction=vec.Vector, Length=expr("L/100", newtons))
line_2 = LineSDL(Start=pt_2, Direction=cluster.V, Length=expr("abs(L)/500", newtons_2))
# We have 2 options for making forces - the top one is new, and uses 3 rotations of a unit z vector, and i like it better than the previous version
vdis = VectorDisplay(Anchor=cluster.G_2, Vector=cluster.V_2)
merge = Merge(Data1=vec_2.Vector, Data2=vec.Vector, Data3=pt)
rev = Reverse(Vector=vec_2.Vector)
path_mapper = PathMapper(cluster.R, source="{0}", target="{0}")
vdis_2 = VectorDisplay(Anchor=pt, Vector=rev)
path_mapper_2 = PathMapper(merge, source="{0}", target="{1}")

# ----
# Add new material in the same manner as described above.
# 
# All materials have by default 4 parameters.  However, these are not all used by each material. For example, membrane materials do not take a value for second moment of inertia.  In these cases, the set value is ignored.
# pre specified materials
youngs_modulus_of_elasticity_e = Slider(500000, range=0..1000000)
youngs_modulus_of_elasticity_e_2 = Slider(500000, range=0..1000000)
youngs_modulus_of_elasticity_e_3 = Slider(500000, range=0..1000000)
second_moment_of_inertia_i = Slider(0.81, range=0..1)
second_moment_of_inertia_i_2 = Slider(0.81, range=0..1)
coefficient = Slider(0.81, range=0..1)
second_moment_of_inertia_i_3 = Slider(0.81, range=0..1)
coefficient_2 = Slider(0.81, range=0..1)
coefficient_3 = Slider(0.81, range=0..1)
sectional_area_a = Slider(0.25, range=0..1)
sectional_area_a_2 = Slider(0.25, range=0..1)
sectional_area_a_3 = Slider(0.25, range=0..1)
# material info is stored in the file PreSpecifiedMaterials.py
list = ValueList({"GFRP": 0, "STEEL": 1, "MEMBRANE": 2}, selected=["GFRP", "STEEL", "MEMBRANE"])
merge_2 = Merge(
    Data1="MATERIAL ONE",
    Data2=youngs_modulus_of_elasticity_e,
    Data3=sectional_area_a_2,
    Data4=second_moment_of_inertia_i_2,
    Data5=coefficient)
merge_3 = Merge(
    Data1="MATERIAL TWO",
    Data2=youngs_modulus_of_elasticity_e_2,
    Data3=sectional_area_a,
    Data4=second_moment_of_inertia_i_3,
    Data5=coefficient_2)
merge_4 = Merge(
    Data1="MATERIAL THREE",
    Data2=youngs_modulus_of_elasticity_e_3,
    Data3=sectional_area_a_3,
    Data4=second_moment_of_inertia_i,
    Data5=coefficient_3)
path_mapper_3 = PathMapper(merge_2, source="{0}", target="{0}")
path_mapper_4 = PathMapper(merge_3, source="{0}", target="{1}")
path_mapper_5 = PathMapper(merge_4, source="{0}", target="{2}")

# ----
# Cable Elements
panel = Panel("MATERIAL FOUR")
crv = Curve(<curve referenced from the Rhino model>)
crv_2 = Curve([<curve referenced from the Rhino model> x4])
path_mapper_6 = PathMapper([panel, crv], source="{0}", target="{0}")
path_mapper_7 = PathMapper(["MATERIAL FOUR", crv_2], source="{0}", target="{1}")
merge_5 = Merge(Data1=path_mapper_6, Data2=path_mapper_7)

# ----
# Elastics Elements
panel_2 = Panel("MATERIAL THREE")
crv_3 = Curve([<curve referenced from the Rhino model> x3])
crv_4 = Curve([<curve referenced from the Rhino model> x9])
path_mapper_8 = PathMapper([panel_2, crv_3], source="{0}", target="{0}")
path_mapper_9 = PathMapper(["MATERIAL THREE", crv_4], source="{0}", target="{1}")
merge_6 = Merge(Data1=path_mapper_8, Data2=path_mapper_9)

# ----
# ELEMENTS
# To make a new element collection, copy paste the naming panel, the curve collection and the path mapper. Increase the target value of the path mapper to the next unique integer.  Select new curves and name as appropriate.
# Bending Elements
panel_3 = Panel("MATERIAL ONE")
crv_5 = Curve(<curve referenced from the Rhino model>)
crv_6 = Curve([<curve referenced from the Rhino model> x2])
path_mapper_10 = PathMapper([panel_3, crv_6], source="{0}", target="{0}")
path_mapper_11 = PathMapper(["STEEL", crv_5], source="{0}", target="{1}")
merge_7 = Merge(Data1=path_mapper_10, Data2=path_mapper_11)

merge_8 = Merge(Data1=path_mapper_3, Data2=path_mapper_4, Data3=path_mapper_5)
python = PythonScript(preSpecified=list, userDefined=merge_8)  # -> out, a; inputs preSpecified: list, userDefined: tree
# ---------- python: Python ----------
from PreSpecMaterials import Materials
import clr
clr.AddReference("Grasshopper")
from Grasshopper.Kernel.Data import GH_Path
from Grasshopper import DataTree

PreSpecMatList = userDefined
exLength = PreSpecMatList.BranchCount

mat = Materials()

for preset in preSpecified:
    exLength += 1
    if preset == 0:#GFRP
        for i in mat.gfrp():
            PreSpecMatList.Add(i, GH_Path(exLength))
    elif preset ==1:#STEEL
        for i in mat.steel():
            PreSpecMatList.Add(i, GH_Path(exLength))
    elif preset ==2:#MEMBRANE
        for i in mat.membrane():
            PreSpecMatList.Add(i, GH_Path(exLength))
        
a = PreSpecMatList
# ---------- end python ----------
merge_9 = Merge(Data1=path_mapper, Data2=path_mapper_2)
fixed_points = Point([<point referenced from the Rhino model> x6])
constrained_points = Point([<point referenced from the Rhino model> x4])
# make as low as possible 2200
run = BooleanToggle(False)
reset = BooleanToggle(False)
adjust_forces = BooleanToggle(False)
step_size = Slider(2200, range=1..50000)
timer = Timer(TimerInterval=2, Target=dynamic_relaxation_engine)
dynamic_relaxation_engine = PythonScript(
    bendings=merge_7,
    elastics=merge_6,
    cables=merge_5,
    loads=merge_9,
    fixedPoints=fixed_points,
    constrainedPoints=constrained_points,
    materials=python.a,
    run=run,
    reset=reset,
    step=step_size,
    adjust=adjust_forces)  # -> out, bendingsOUT, elasticsOUT, cablesOUT, stressOUT, stressMinMax, loadsOUT, fixedPointsOUT, particles; inputs bendings: tree, elastics: tree, cables: tree, loads: tree of Point3d, fixedPoints: list of Point3d, constrainedPoints: list of Point3d, materials: tree
# ---------- dynamic_relaxation_engine: Python ----------
import Rhino # this is all the Rhino common classes and stuff (documentation here: http://4.rhino3d.com/5/rhinocommon/)
import rhinoscriptsyntax as rs
import sys
#import DynamicRelaxationFaster as DynamicRelaxation
import DynamicRelaxation
from PreSpecMaterials import Materials
import itertools
import clr
clr.AddReference("Grasshopper")
from Grasshopper.Kernel.Data import GH_Path
from Grasshopper import DataTree
import System.Guid
"""This component takes as input different sets of lines to define a dynamic relaxation (DR) process to find their equilibrium position.

This is the first example of a (hopefully) running code.

There are of course several things that need to be done:
    
    TODO allow for different materials in same kind of elements (e.g. tow different bending stiffnesses) maybe as pairs sets [ [list,material],[otherlist]other material]]
    TODO have a way to define generic materials (young modulus E + section area A + second moment of inertia I)(as a python class?)
    TODO add load elements as triple [position, direction, value]

The code is heavily inspired by the TraerPhysics library for Processing by J. Traer and several amendments/improvements 
made by Guillaume Labelle and Julien Nembrini in TraerAnar as a link to the ANAR+ library (http://anar.ch) 

This code is copyrighted by Julien Nembrini and distributed open source in the sense of the Gnu GPL v3.0. 

"""

#@@@@@@@@@@@@@@@@@@@@@@@@@@@@@@@
#@@@@@@@@@@@@@@@@@@@@@@@@@@@@@@@
#@@@@@@@@@@@@@@@@@@@@@@@@@@@@@@@
#@@@@@@@@@@@@@@@@@@@@@@@@@@@@@@@

def makePtFromRhino(pt):
    return DynamicRelaxation.Point3D(pt.X,pt.Y,pt.Z)
    
def makePtsFromRhino(pts):
    a = []
    for pt in pts:
        a.append(makePtFromRhino(pt))
    return a
    
#@@@@@@@@@@@@@@@@@@@@@@@@@@@@@@@
#@@@@@@@@@@@@@@@@@@@@@@@@@@@@@@@
#@@@@@@@@@@@@@@@@@@@@@@@@@@@@@@@
#@@@@@@@@@@@@@@@@@@@@@@@@@@@@@@@

print 'A prototype for dynamic relaxation in Rhino/GH/python. (c) Julien Nembrini'

#print sys.path

#@@@@@@@@@@@@@@@@@@@@@@@@@@@@@@@
#@@@@@@@@@@@@@@@@@@@@@@@@@@@@@@@
#@@@@@@@@@@@@@@@@@@@@@@@@@@@@@@@
#@@@@@@@@@@@@@@@@@@@@@@@@@@@@@@@

# Initialisation

if reset :

    # create particle system no drag no gravity
    ps = DynamicRelaxation.ParticleSystem()
    #ps = ParticleSystem(Vector3D(0,0,1), 0.5)
    #ps.setIntegrator(DynamicRelaxation.ParticleSystem.EULER)
    
    print ps

    #### materials
    matName = []
    matEval = []
    matAval = []
    matIval = []
    matCval = []

    for i in range(materials.BranchCount):
        matName.append (materials.Branch(i)[0])
        matEval.append (materials.Branch(i)[1])
        matAval.append (materials.Branch(i)[2])
        matIval.append (materials.Branch(i)[3])
        matCval.append (materials.Branch(i)[4])
        
    #### bending elements
    allBendings = [] 
    allBendingsParts = [] 
    for i in range(bendings.BranchCount):
        matSpec = bendings.Branch(i)[0]
        for j in itertools.islice(bendings.Branch(i),1,None):
            if type(j) is System.Guid:
                pts = rs.PolylineVertices(j)
                if pts: 
                    #create the bending elements (registered automagically in ps)
                    parts,bends = DynamicRelaxation.makeBendingsFromList(ps, makePtsFromRhino(pts),matEval[matName.index(matSpec)],matIval[matName.index(matSpec)],matAval[matName.index(matSpec)])
                    # keep a copy for display of the particles making a bending line
                    allBendingsParts.append(parts)
                    allBendings.append(bends)
    
    print 'bendings :' + str(len(ps.bendings))
    
    #### elastic elements
    allElastics = [] 
    allElasticsParts = [] 
    
    for i in range(elastics.BranchCount):
        matSpec = elastics.Branch(i)[0]
        for j in itertools.islice(elastics.Branch(i),1,None):
            if type(j) is System.Guid:
                pts = rs.PolylineVertices(j)
                if pts: 
                    #create the bending elements (registered automagically in ps)
                    parts,elas = DynamicRelaxation.makeElasticsFromList(ps, makePtsFromRhino(pts), matEval[matName.index(matSpec)], matAval[matName.index(matSpec)], 0,  matCval[matName.index(matSpec)])##HOW TO GET TENSIONED ELASTICS?
                    # keep a copy for display of the particles making a bending line
                    allElasticsParts.append(parts)
                    allElastics.append(elas)

    print 'elastics :' + str(len(ps.elastics))

    #### cables elements
    allCables = [] 
    allCablesParts = [] 

    for i in range(cables.BranchCount):
        matSpec = cables.Branch(i)[0]
        for j in itertools.islice(cables.Branch(i),1,None):
            if type(j) is System.Guid:
                pts = rs.PolylineVertices(j)
                if pts: 
                    #create the bending elements (registered automagically in ps)
                    parts,cabls = DynamicRelaxation.makeCablesFromList(ps, makePtsFromRhino(pts))
                    # keep a copy for display of the particles making a bending line
                    allCablesParts.append(parts)
                    allCables.append(cabls)

    print 'cables :' + str(len(ps.cables))
    
    #### loads
    allLoads = [] 
    allLoadsParts = [] 

    for i in range(loads.BranchCount):
        dir = loads.Branch(i)[0]
        force = loads.Branch(i)[1]
        pts = []
        for j in itertools.islice(loads.Branch(i),2,None):
            if j is not None: pts.append (j)
            
        #create the load elements (registered automagically in ps)
        parts,lds = DynamicRelaxation.makeLoadsFromList(ps, makePtsFromRhino(pts),makePtFromRhino(dir),force.X) # TODO why is force a point3D, ia it to have only points
        # keep a copy for display of the particles making a load
        allLoadsParts.append(parts)
        allLoads.append(lds)
        
    print 'loads :' + str(len(ps.loads))
    
    # TODO make a construction loop for the remaining kind of elements
    #DynamicRelaxation.makeSpringsFromList(ps, makePtsFromRhino(pts),1,0)
    #DynamicRelaxation.makeAttractionsFromList(ps, makePtsFromRhino(pts),100)
    cPoints = []
    for j in constrainedPoints:
        if j is not None: cPoints.append (j)
    DynamicRelaxation.makeConstraintsFromList(ps,makePtsFromRhino(cPoints))#GENERAL PROBLEM WITH NONE ITEMS HERE
    
    # fix particles at the end
    for pt in fixedPoints:
        ps.findParticleEqualToPoint(makePtFromRhino(pt)).makeFixed()
    
    print 'particles :' + str(len(ps.particles))

    stepCount = 0

#@@@@@@@@@@@@@@@@@@@@@@@@@@@@@@@
#@@@@@@@@@@@@@@@@@@@@@@@@@@@@@@@
#@@@@@@@@@@@@@@@@@@@@@@@@@@@@@@@
#@@@@@@@@@@@@@@@@@@@@@@@@@@@@@@@

#adjustment of material parameters during simulation

if adjust:
    #### import all material parameters again
    matName = []
    matEval = []
    matAval = []
    matIval = []
    matCval = []

    for i in range(materials.BranchCount):
        matName.append (materials.Branch(i)[0])
        matEval.append (materials.Branch(i)[1])
        matAval.append (materials.Branch(i)[2])
        matIval.append (materials.Branch(i)[3])
        matCval.append (materials.Branch(i)[4])

    #### apply material adjustments to elements
    for bending in allBendings:
        for bend in bending:
                bend.setEI( 100, 100 )
                bend.setES( 100, 100 )
        #So this works, but.......
        #the problem here is that a bend (or any element) has no memory of its material. Its ordering within a 2D array has also been lost (which is a shame - perhaps a site for future work)
        #It may be that the easiest way to do this is to add a self.materialName to the Bending class.  This would store the material name, ie. GFRP or MATERIAL ONE. If the name doesnt change, just the values, then we can find the name in the list and use its index to assign the new values.


#@@@@@@@@@@@@@@@@@@@@@@@@@@@@@@@
#@@@@@@@@@@@@@@@@@@@@@@@@@@@@@@@
#@@@@@@@@@@@@@@@@@@@@@@@@@@@@@@@
#@@@@@@@@@@@@@@@@@@@@@@@@@@@@@@@

# Dynamic Relaxation step

if run:
    for i in range(10):
        ps.step(step)
    ps.stepRelax(step)
    #stepCount += 1
    #print stepCount


#@@@@@@@@@@@@@@@@@@@@@@@@@@@@@@@
#@@@@@@@@@@@@@@@@@@@@@@@@@@@@@@@
#@@@@@@@@@@@@@@@@@@@@@@@@@@@@@@@
#@@@@@@@@@@@@@@@@@@@@@@@@@@@@@@@

# Display functions

#center = Rhino.Geometry.Point3d((supportPtsIn[0].X + supportPtsIn[1].X) * .5, (supportPtsIn[0].Y + supportPtsIn[1].Y) * .5, (supportPtsIn[0].Z + supportPtsIn[1].Z) * .5)

bendingsOUT = DataTree[Rhino.Geometry.PolylineCurve]()
elasticsOUT = DataTree[Rhino.Geometry.PolylineCurve]()
cablesOUT = DataTree[Rhino.Geometry.PolylineCurve]()
stressOUT = DataTree[float]()
stressSort = []
stressMinMax = []
loadsOUT = []

print allBendings[0]
# compare bending force between top and bottom of arch 
for i in range(len(allBendings)):
    path = GH_Path(i)
    for j in range(0, len(allBendings[i])+1):
        if j == 0:
            print 'low'
            tmpStress = allBendings[i][j].getStress()
        elif j == len(allBendings[i]):
            print 'high'
            tmpStress = allBendings[i][j-1].getStress()
        else:
            tmpStress = (allBendings[i][j].getStress()+allBendings[i][j-1].getStress())*0.5
        stressOUT.Add(tmpStress, path)
        stressSort.append(tmpStress)

stressSort.sort()
stressMinMax.append(stressSort[0])
stressMinMax.append(stressSort[-1])

for i in range(len(allBendingsParts)):
    path = GH_Path(i)
    parts = []
    
    for p in allBendingsParts[i] :
        part = Rhino.Geometry.Point3d(p.position.x(), p.position.y(), p.position.z())
        parts.append(part)
    bendingsOUT.Add(Rhino.Geometry.PolylineCurve(parts), path)

for i in range(len(allElasticsParts)):
    path = GH_Path(i)
    parts = []
    for p in allElasticsParts[i] :
        part = Rhino.Geometry.Point3d(p.position.x(), p.position.y(), p.position.z())
        parts.append(part)
    elasticsOUT.Add(Rhino.Geometry.PolylineCurve(parts), path)

for i in range(len(allCablesParts)):
    path = GH_Path(i)
    parts = []
    for p in allCablesParts[i]:
        part = Rhino.Geometry.Point3d(p.position.x(), p.position.y(), p.position.z())
        parts.append(part)
    cablesOUT.Add(Rhino.Geometry.PolylineCurve(parts), path)

particles = []
for p in ps.particles:
    part = Rhino.Geometry.Point3d(p.position.x(), p.position.y(), p.position.z())
    particles.append(part)

#curveOut = Rhino.Geometry.PolylineCurve(pts)
# ---------- end dynamic_relaxation_engine ----------
pt_3 = Point(dynamic_relaxation_engine.particles)
crv_7 = Curve(dynamic_relaxation_engine.elasticsOUT)
panel_4 = Panel(dynamic_relaxation_engine.stressOUT)
item = ListItem(List=dynamic_relaxation_engine.stressMinMax, Index=1, Wrap=True)
item_2 = ListItem(List=dynamic_relaxation_engine.stressMinMax, Index=0, Wrap=True)
gradient = Gradient(
    LowerLimit=item_2,
    UpperLimit=item,
    Parameter=dynamic_relaxation_engine.stressOUT,
    stops=[0: RGB(0, 0, 255), 0.494: RGB(255, 255, 0), 1: RGB(255, 0, 0)])
panel_5 = Panel(dynamic_relaxation_engine.elasticsOUT)
explode = Explode(Curve=dynamic_relaxation_engine.bendingsOUT, Recursive=True)  # -> Segments, Vertices
panel_6 = Panel(explode.Segments)
preview = CustomPreview(Geometry=explode.Segments, Shader=gradient)

# ==== cluster Cluster
line = LineSDL(Start=Point(0, 0, 0), Direction=Vector(1, 0, 0), Length=1)
line_2 = LineSDL(Start=Point(0, 0, 0), Direction=Vector(0, 1, 0), Length=1)
line_3 = LineSDL(Start=Point(0, 0, 0), Direction=Vector(0, 0, 1), Length=1)
line_4 = LineSDL(Start=Point(0, 0, 0), Direction=Vector(0, 0, 1), Length=1)
A = ClusterInput()
X = ClusterInput()
vrot = Rotate(Vector=line_4, Axis=line, Angle=degrees(A))
vec = VectorXYZ(XComponent=X, YComponent=0, ZComponent=0)  # -> Vector, Length
A_2 = ClusterInput()
A_3 = ClusterInput()
vrot_2 = Rotate(Vector=vrot, Axis=line_2, Angle=degrees(A_2))
vrot_3 = Rotate(Vector=vrot_2, Axis=line_3, Angle=degrees(A_3))
G = ClusterInput()
rev = Reverse(Vector=vrot_3)
V = ClusterOutput(vrot_3)
d3 = ClusterInput()
move = Move(Geometry=G, Motion=vrot_3)  # -> Geometry, Transform
V_2 = ClusterOutput(rev)
merge = Merge(Data1=rev, Data2=vec.Vector, Data3=d3)
G_2 = ClusterOutput(move.Geometry)
R = ClusterOutput(merge)
