# Grasshopper definition DynamicRelaxation.gh (Grasshopper 0.9.61)
# plug-ins: Python Interpreter

pt = Point([Point(0, 0, 0), Point(15, 0, 0)])
# This is some geometry from Rhino
crv = Curve(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)
subdiv = Slider(14, range=0..24)
timer = Timer(TimerInterval=200, Target=dynamic_relaxation_engine)
# The names you give the input/output parameters, are accessible within the script (you do not need to declare anything)
# Also, if you right click an input parameter you can tell python what type of variable it is using the 'type hint' in the bottom
run = BooleanToggle(True)
reset = BooleanToggle(True)
dynamic_relaxation_engine = PythonScript(curveIn=crv, supportPtsIn=pt, subDiv=subdiv, run=run, reset=reset)  # -> out, curveOut, curvePoints; inputs curveIn: Curve, supportPtsIn: list of Point3d, subDiv: Int32
# ---------- dynamic_relaxation_engine: Python ----------
import Rhino # this is all the Rhino common classes and stuff (documentation here: http://4.rhino3d.com/5/rhinocommon/)

"""This component takes as input different sets of lines to define a dynamic relaxation (DR) process to find their equilibrium position.


This is the first example of a (hopefully) running code.

There are of course several things than need to be done:
    
    TODO allow for different materials in same kind of elements (e.g. tow different bending stiffnesses) maybe as pairs sets [ [list,material],[otherlist]other material]]
    TODO have a way to define generic materials (young modulus E + section area A + second moment of inertia I)(as a python class?)
    TODO add load elements as triple [position, direction, value]

The code is heavily inspired by the TraerPhysics library for Processing by J. Traer and several amendments/improvements 
made by Guillaume Labelle and Julien Nembrini in TraerAnar as a link to the ANAR+ library (http://anar.ch) 

This code is copyrighted by Julien Nembrini and distributed open source in the sense of the Gnu GPL v3.0. 

"""

class Vector3D:

    def __init__(self,x,y,z):
        self._x = x
        self._y = y
        self._z = z
        
    def __init__(self):
        self.__init__(0,0,0)
   
    def __init__(self,v):
        self.__init__(v.x(),v.y(),v.z())
        
    def x: return self._x
    def y: return self._x
    def z: return self._x
        
    def set(x,y,z):self._x = x; self._y = y; self._z = z; return self     
    def set(v):set(v.x(),v.y(),v.z()); return self 
        
    def setX(x):self._x = x; return self 
    def setY(y):self._y = y; return self 
    def setZ(z):self._z = z; return self 


	def __add__(self, p ): return Vector3D(self.x()+p.x(),self.y()+p.y(),self.z()+p.z()
	def __sub__(self, p ): return Vector3D(self.x()-p.x(),self.y()-p.y(),self.z()-p.z()
	  
	def add(self, a,b,c ): return Vector3D(self._x += a, self._y += b, self._z += c)
	def subtract(self, a, b, c): return Vector3D(self._x -= a, self._y -= b, self._z -= c)
		  
	def multiplyBy(self,  f ): return Vector3D(self._x *= f, self._y *= f, self._z*= f)
	def __mul__(self,  v ): return Vector3D( self._x*v.x(),self._y*v.y(), self._z*v.z())
	def divideBy(self,  f ): return Vector3D(self._x /= f, self._y /= f, self._z/= f)
	def __div__(self,  v ): return Vector3D( self._x/v.x(),self._y/v.y(), self._z/v.z())
	
	def distanceTo(self, x, y, z ): dx = self._x - x; dy = self._y - y; dz = self._z - z; return sqrt( dx*dx + dy*dy + dz*dz )
	def distanceTo(self, p ): return sqrt( distanceSquaredTo(self, p ) )
	def distanceSquaredTo(self, p ): dx =  self._x-p.x; dy =  self._y-p.y; dz =  self._z-p.z; return dx*dx + dy*dy + dz*dz
	
	
	def dot(self, p ): return self._x*p.x + self._y*p.y + self._z*p.z
	def length(self): return sqrt( lengthSquared(self) )
	def lengthSquared(self): return self._x*self._x + self._y*self._y + self._z*self._z 
	
	def normalize(self): return Vector3D(self).divideBy(length(self))
	  
	def clear(self):self._x = 0; self._y = 0; self._z = 0; return self

	
	def __str__(self): return "(" + self._x + ", " + self._y + ", " + self._z + ")" )

	def __neg__(self): return Vector3D(self.x(),self.y(),-self.z())
	def cross(self, p ): return Vector3D( 	self.y*p.z - self.z*p.y, self.z*p.x - self.x*p.z, self.x*p.y - self.y*p.x )
	
	def isZero(self): return self._x == 0 && self._y == 0 && self._z == 0;

	def distanceSegmentSq(self, p, q) :
		v = q - p
		w = self - p
		
		c1 = w.dot(v)
		if ( c1 <= 0 ):
		    return self.distanceSquaredTo(p);
		
		c2 = v.dot(v)
		if ( c2 <= c1 ):
		    return self.distanceSquaredTo(q);
		    
		b = c1 / c2
		Pb =  p + v.multiplyBy(b));
		return self.distanceSquaredTo(Pb);


	
	def distanceLineSq(self, p, q) {
	    v = q - p
		w = self - p
	    c1 = w.dot(v);
	    c2 = v.dot(v);
	    b = c1 / c2;
	    Pb =  p + v.multiplyBy(b));
	    return this.distanceSquaredTo(Pb);


    #	 * project on plane	 * assume normalized direction	 * @param dir
	def project(self, dir) : t = -self.dot(dir); return Vector3D(self + dir.multiplyBy(t))
	
	
    #	 * project on vector	 * assume normalized direction	 * @param dir
	def projectDir( dir) : t = self.dot(dir); return Vector3D(self + dir.multiplyBy(t))

	
	
class Particle
{
  protected Vector3D position;
  protected Vector3D velocity;
  protected Vector3D force;
  protected Vector3D mass;
  protected float age;
  protected boolean dead;
  
  boolean fixed;
  
  protected Vector3D constraint;
  boolean constrained;
	
  public Particle( float m )
  {
	  position = new Vector3D();
	  velocity = new Vector3D();
	  force = new Vector3D();
	  mass = new Vector3D(m,m,m);
	  fixed = false;
	  age = 0;
	  dead = false;

	  constraint = new Vector3D();
	  constrained = false;

  }
  
  /* (non-Javadoc)
 * @see traer.physics.AbstractParticle#distanceTo(traer.physics.Particle)
 */
public final float distanceTo( Particle p )
  {
	  return this.position().distanceTo( p.position() );
  }
  
  /* (non-Javadoc)
 * @see traer.physics.AbstractParticle#makeFixed()
 */
public final void makeFixed()
  {
	  fixed = true;
	  velocity.clear();
  }
  
  /* (non-Javadoc)
 * @see traer.physics.AbstractParticle#isFixed()
 */
public final boolean isFixed()
  {
	  return fixed;
  }
  
  /* (non-Javadoc)
 * @see traer.physics.AbstractParticle#isFree()
 */
public final boolean isFree()
  {
	  return !fixed;
  }
/**
 * return the constrained state of the particle
 * 
 * @return
 */
public final boolean isConstrained()
{
	  return constrained;
}


  /* (non-Javadoc)
 * @see traer.physics.AbstractParticle#makeFree()
 */
public final void makeFree()
  {
	  fixed = false;
  }
  
  /* (non-Javadoc)
 * @see traer.physics.AbstractParticle#position()
 */
public final Vector3D position()
  {
	  return position;
  }
  
  public final Vector3D velocity()
  {
	  return velocity;
  }
  
  /* (non-Javadoc)
 * @see traer.physics.AbstractParticle#mass()
 */
public final Vector3D mass()
  {
	  return mass;
  }
  

public final float massAverage()
{
	  return (mass.x() + mass.y() + mass.z())/3f;
	  
}

  /* (non-Javadoc)
 * @see traer.physics.AbstractParticle#setMass(float)
 */
public final void setMass( float m )
  {
	  mass = new Vector3D(m,m,m);
  }
  
  /* (non-Javadoc)
 * @see traer.physics.AbstractParticle#force()
 */
public final Vector3D force()
  {
	  return force;
  }

/**
 * set constraint plane for the particle based on actual position
 * 
 * @param nx - x component of normal to constraint plane
 * @param ny - y component of normal to constraint plane
 * @param nz - z component of normal to constraint plane
 */

public final void constrained(float nx, float ny, float nz) {
	constraint = new Vector3D(nx,ny,nz);
	constraint.normalize();
	constrained = true;
}

public final Vector3D getConstraint() {
	  return constraint;
}

/** 
 * project forces acting on the particle on the constraint plane
 */
public void constraint() {
	force.project(constraint);
}

/** 
 * to allow some processing before constraining force 
 */
public void update() {
	
}

  /* (non-Javadoc)
 * @see traer.physics.AbstractParticle#age()
 */
public final float age()
  {
	  return age;
  }
  
  protected void reset()
  {
	  age = 0;
	  dead = false;
	  position.clear();
	  velocity.clear();
	  force.clear();
	  mass = new Vector3D(1f,1f,1f);
  }
}




















public class ParticleSystem
{
	public static final int RUNGE_KUTTA = 0;
    public static final int MODIFIED_EULER = 1;
    public static final int VERLET = 2;
    public static final int EULER = 3;
	
	protected static final float DEFAULT_GRAVITY = 0;
	protected static final float DEFAULT_DRAG = 0.001f;	
	
  ArrayList<Particle> particles;
  ArrayList<Force> springs;
  ArrayList<Force> attractions;
  ArrayList<Force> bendings;
  ArrayList<Force> elastic;
  ArrayList<Force> cables;  
  ArrayList<Force> multicables;
  ArrayList<Force> loads;
  ArrayList<Force> customForces = new ArrayList<Force>();
 
  Integrator integrator;
  
  Vector3D gravity;
  float drag;

  public static boolean hasConstrainedParticles = false;
  
  boolean hasDeadParticles = false;
  
  public final void setIntegrator( int integrator ) {
	switch ( integrator )
	{
		case RUNGE_KUTTA:
			this.integrator = new RungeKuttaIntegrator( this );
			break;
		case MODIFIED_EULER:
			this.integrator = new ModifiedEulerIntegrator( this );
			break;
		case VERLET:
		  this.integrator = new VerletIntegrator( this );
		  break;
		case EULER:
			this.integrator = new EulerIntegrator( this );
			break;
	}
  }
  
  public final void setGravity( float x, float y, float z ) {
	  gravity.set( x, y, z );
  }
  
  // default down gravity
  public final void setGravity( float g ) {
	  gravity.set( 0, g, 0 );
  }
  
  public final void setDrag( float d ) {
	  drag = d;
  }
  
  public final void tick() {
	  tick( 1 );
  }
  
  public final void tick( float t ) {  
	  integrator.step( t );	  
  }

  static float prevKinetic = 0f;
  
  public final void tickRelax( float t ) {  
	  integrator.step( t );

	  float tmp = computeKinetic();
	  if (tmp < prevKinetic - 10e-04f) {
		  Iterator<Particle> itP = particles.iterator();
		  while (itP.hasNext()) itP.next().velocity.clear();
		  prevKinetic = 0f;
	  }
	  else prevKinetic = tmp;

  }

  public float computeKinetic() {
	  
	  float kinetic = 0f;
	  
	  Iterator<Particle> itP = particles.iterator();
	  while (itP.hasNext()) { 
		  Particle p = itP.next();
		  kinetic += .5f * p.mass().dot(p.velocity.multiply(p.velocity));
	  }
	  return kinetic;
  }

  
  public final Particle makeParticle( float mass, float x, float y, float z ) {
	  Particle p = new Particle( mass );
	  p.position().set( x, y, z );
	  particles.add( p );
	  return p;
  }
  
  public final Particle makeParticle() {  
	  return makeParticle( 1.0f, 0f, 0f, 0f );
  }
  
  public final Spring makeSpring( Particle a, Particle b, float ks, float d, float r ) {
	  Spring s = new Spring( a, b, ks, d, r );
	  springs.add( s );
	  return s;
  }
  
  public final Attraction makeAttraction( Particle a, Particle b, float k, float minDistance ) {
	  Attraction m = new Attraction( a, b, k, minDistance );
	  attractions.add( m );
	  return m;
  }

  public final Bending makeBending( Particle a, Particle b, Particle c, float E, float I, float S ) {
	  Bending m = new Bending( a, b, c, E , I , S);
	  bendings.add( m );
	  return m;
  }

  public final Bending makeBending( Particle a, Particle b, Particle c, float l1, float l2, float E, float I, float S ) {
	  Bending m = new Bending( a, b, c, l1, l2, E , I , S);
	  bendings.add( m );
	  return m;
  }

  public final Elastic makeElastic( Particle a, Particle b, float E, float A, float l0, float t0 ) {
	  Elastic m = new Elastic( a, b, E , A , l0, t0);
	  elastic.add( m );
	  return m;
  }

  public final Cable makeCable( Particle a, Particle b, float E, float A, float l0, float t0 ) {
	  Cable m = new Cable( a, b, E , A , l0, t0);
	  cables.add( m );
	  return m;
  }
  
  public final MultiCable makeMultiCable( Particle[] a, float E, float A, float l0, float t0 ) {
	  MultiCable m = new MultiCable( a, E , A , l0, t0);
	  multicables.add( m );
	  return m;
  }
  
  
  public final Load makeLoad( Particle a, Vector3D v, float f) {
	  Load m = new Load( a, v, f);
	  loads.add( m );
	  return m;
  }

  public final void addCustomForce( Force f ){	  customForces.add( f );  }  

  
  public final void clear() {
	  particles.clear();
	  springs.clear();
	  attractions.clear();
	  bendings.clear();
	  elastic.clear();
	  cables.clear();
	  multicables.clear();
	  loads.clear();
  }

  private void init() {
		integrator = new RungeKuttaIntegrator( this );
		
	    particles = new ArrayList<Particle>();
	    springs = new ArrayList<Force>();
	    attractions = new ArrayList<Force>();
	    bendings = new ArrayList<Force>();
	    elastic = new ArrayList<Force>();
	    cables = new ArrayList<Force>();
	    multicables = new ArrayList<Force>();
	    loads = new ArrayList<Force>();
  }
  
  public ParticleSystem( float g, float somedrag ) {
    init();
    gravity = new Vector3D( 0, g, 0 );
    drag = somedrag;
  }
  
  public ParticleSystem( float gx, float gy, float gz, float somedrag ) {
    init();
    gravity = new Vector3D( gx, gy, gz );
    drag = somedrag;
  }
  
  public ParticleSystem() {
	init();
	gravity = new Vector3D( 0, ParticleSystem.DEFAULT_GRAVITY, 0 );
	drag = ParticleSystem.DEFAULT_DRAG;
  }
  
  protected final void applyForces() {
	  
	  if ( !gravity.isZero() ) 
		  for (Particle p:particles)  p.force.add(gravity);
	
	  for (Particle p:particles)  
		  p.force.add( p.velocity.x() * -drag, p.velocity.y() * -drag, p.velocity.z() * -drag );
	  
	  for (Force f: springs) f.apply();
	  for (Force f: attractions) f.apply();
	  for (Force f: bendings) f.apply();
	  for (Force f: elastic) f.apply();
	  for (Force f: cables) f.apply();
	  for (Force f: multicables) f.apply();
	  for (Force f: loads) f.apply();
	  for (Force f: customForces) f.apply();
	  
	  if (hasConstrainedParticles) {
	    for (Particle p:particles) {
	    	p.update();
	    	p.constraint();
	    }
	  }
	  
  }
  
  protected final void clearForces() {
	  Iterator<Particle> i = particles.iterator();
	  while ( i.hasNext() )  i.next().force.clear();
  }
  
  public final int numberOfParticles(){	  return particles.size();  }  
  public final int numberOfSprings(){	  return springs.size();  }  
  public final int numberOfAttractions(){	  return attractions.size();  }  
  public final int numberOfBendings(){	  return bendings.size();  }
  public final int numberOfElastic(){	  return elastic.size();  }
  public final int numberOfCables(){	  return cables.size();  }
  public final int numberOfMultiCables(){	  return multicables.size();  }
  public final int numberOfLoads(){	  return loads.size();  }
  public final int numberOfCustomForces(){	  return customForces.size();  }  
  
  public final Particle getParticle( int i ){	  return (Particle)particles.get( i );  }  
  public final Spring getSpring( int i ){	  return (Spring)springs.get( i );  }  
  public final Attraction getAttraction( int i ){	  return (Attraction)attractions.get( i );  }
  public final Bending getBending( int i ){	  return (Bending)bendings.get( i );  }
  public final Elastic getElastic( int i ){	  return (Elastic)elastic.get( i );  }
  public final Cable getCable( int i ){	  return (Cable)cables.get( i );  }
  public final MultiCable getMultiCable( int i ){	  return (MultiCable)multicables.get( i );  }
  public final Load getLoad( int i ){	  return (Load)loads.get( i );  }
  public final Force getCustomForce( int i ){	  return (Force)customForces.get( i );  }  
  
  public final Particle removeParticle( int i ){	  return (Particle) particles.remove( i );  }  
  public final Spring removeSpring( int i ){	  return (Spring)springs.remove( i );  }  
  public final Attraction removeAttraction( int i  ){	 return (Attraction)attractions.remove( i );  }
  public final Bending removeBending( int i  ){		 return (Bending)bendings.remove( i );  }
  public final Elastic removeElastic( int i  ){		 return (Elastic)elastic.remove( i );  }
  public final Cable removeCable( int i  ){		 return (Cable)cables.remove( i );  }
  public final MultiCable removeMultiCable( int i  ){		 return (MultiCable)multicables.remove( i );  }
  public final Load removeLoad( int i  ){		 return (Load)loads.remove( i );}
  public final Force removeCustomForce( int i ){	  return (Force)customForces.remove( i );  }  
  
  public final void removeParticle( Particle p ){	  particles.remove( p );  }  
  public final void removeSpring( Spring a ) {	  springs.remove( a );  }  
  public final void removeAttraction( Attraction s ){	  attractions.remove( s );  }
  public final void removeBending( Bending s ){	  bendings.remove( s );  }
  public final void removeElastic( Elastic s ){	  elastic.remove( s );  }
  public final void removeCable( Cable s ){	  cables.remove( s );  }
  public final void removeMultiCable( MultiCable s ){	  multicables.remove( s );  }
  public final void removeLoad( Load s ){	  loads.remove( s );  }
  public final void removeCustomForce( Force f ){	  customForces.remove( f );  }  

}

class Integrator:
    
    def step(value):
        pass
        

class VerletIntegrator(Integrator):
    
    # number of iterations for constraints
    _NUM_ITERATIONS = 10
    
    def __init__(self,particleSystem):
	    self._ps = particleSystem
	    
	def step( t ):
	    
		self._ps.clearForces();
		self._ps.applyForces();
	    
	    halftt = 0.5/(t*t);
	    halft = 0.5/t;
	    
	    for p in self._ps.particles:
			if p.isFree():
			    
			    ax = p.force().x()/p.mass().x();
			    ay = p.force().y()/p.mass().y();
			    az = p.force().z()/p.mass().z()
			    
			    # update position
	            p.position().add( p.velocity().x()/t, p.velocity().y()/t, p.velocity().z()/t );
	            p.position().add( ax*halftt, ay*halftt, az*halftt );
	            
	            # half step with previous acceleration
	            p.velocity().add( ax*halft, ay*halft, az*halft );
                
	            # compute forces with new position
	            s.clearForces();
	            s.applyForces();
                
	            # compute acceleration in new position
	            ax = p.force().x()/p.mass().x();
	            ay = p.force().y()/p.mass().y();
	            az = p.force().z()/p.mass().z();
	            
	            # half step with new acceleration
	            p.velocity().add( ax*halft, ay*halft, az*halft );
	            
	    satisfyConstraints();
	  }

	def satisfyConstraints :
	  
	  for j in range(self._NUM_ITERATIONS):
	      
	      TODO

	    for ( int i = 0; i < s.springs.size(); i++ )
	    {
	      Spring f = (Spring)s.springs.get( i );
	      if (f.springConstant == 0f) {
	        // apply constraints
	        
	        // measure distance
          Vector3D a = f.getOneEnd().position();
          Vector3D b = f.getTheOtherEnd().position();
	        
	        Vector3D d1 = new Vector3D(a);
	        d1.subtract(b);
	        float d2 = d1.length(); // potential to optimize with taylor expansion
	        float diff = (d2-f.restLength())/d2;
	        d1.multiplyBy(.5f*diff);
	        a.subtract(d1);
	        b.add(d1);
	      }
	    }
	  }
	  
	}
	
	
   

class EulerIntegrator(Integrator):
	
	def __init__(self,particleSystem):
	    self._ps = particleSystem
	
	def step( t ):
	    
		self._ps.clearForces();
		self._ps.applyForces();
		
		for p in self._ps.particles:
			if p.isFree():
				p.velocity.add( p.force.x/(p.mass.x*t), p.force().y/(p.mass.y*t), p.force.z/(p.mass.z*t) );
				p.position.add( p.velocity.x/t, p.velocity.y/t, p.velocity.z)/t );



class Force:
    
    def __init__(self)
	  self._on = True;
	  
	  def apply:
	      pass
	      
	  def turnOff:
	      self._on = False
	  def turnOff:
	      self._on = True
	      
	  def isOn:
	      return self._on
	  def isOff:
	      return !self._on
	      		  













public class Elastic extends Force
{
  /** E module of elastic material   */
  float E;
  /** section area of elastic material */
  float A;
  /** initial length */
  float l0;
  /** prestress */
  float t0;
  
  public boolean fixTension = false;
  
  Particle a, b;
    
  public Elastic( Particle _a, Particle _b, float _E, float _A, float _l0, float _t0 )
  {
    E = _E;
    A = _A;
    l0 = _l0;
    t0 = _t0;
    a = _a;
    b = _b;
    on = true;
  }
  

  
  public final Particle getOneEnd()  { return a;  }
  public final Particle getTheOtherEnd()  {	  return b;  }
  
  protected void setPartA( Particle p )  {	  a = p;  }
  protected void setPartB( Particle p )  {	  b = p;  }

  public final float currentLength()  {	  return a.position().distanceTo( b.position() );  }
  
  public final float getRestLength()  {	  return l0;  }
  public final void setRestLength( float _l )  {	  l0 = _l;  }

  public final float getPrestress()  {	  return t0;  }
  public final void setPrestress( float _t )  {	  t0 = _t;  }

  
  public final float getE()  {	  return E;  }
  public final void setE(float _E)  {	  E = _E;  }

  public final float getA()  {	  return A;  }
  public final void setA(float _A)  {	  A = _A;  }
    
  
  public void apply()
  {  
	  
	if ( on && ( a.isFree() || b.isFree() ) )
	{
		float a2bX = a.position().x - b.position().x;
		float a2bY = a.position().y - b.position().y;
		float a2bZ = a.position().z - b.position().z;
		
		float a2bDistance = (float)Math.sqrt( a2bX*a2bX + a2bY*a2bY + a2bZ*a2bZ );
		
		if ( a2bDistance == 0 )
		{
			a2bX = 0;
			a2bY = 0;
			a2bZ = 0;
		}
		else
		{
			a2bX /= a2bDistance;
			a2bY /= a2bDistance;
			a2bZ /= a2bDistance;
		}

		// elastic force is proportional to how much it stretched 
		// t = EA/l0 * (l-l0) + t0  

		float elasticForce = 0;
		
		// if tension not fixed
		if (!fixTension)
			elasticForce = -( a2bDistance - l0 ) * E*A/l0 + t0;
		// if tension fixed prestress only
		else elasticForce = t0;


		a2bX *= elasticForce;
		a2bY *= elasticForce;
		a2bZ *= elasticForce;

		if ( a.isFree() )
			a.force().add( a2bX, a2bY, a2bZ );

		// forceB is same as forceA in opposite direction
		if ( b.isFree() )
			b.force().add( -a2bX, -a2bY, -a2bZ );

	}
	
  }

}




public class Cable extends Elastic
{
   
	public boolean slack = false;
	
  public Cable( Particle _a, Particle _b, float _E, float _A, float _l0, float _t0 )
  {
    super(_a,_b,_E,_A,_l0,_t0);
  }
  
  @Override
  public void apply()
  {  
	  
	if ( on && ( a.isFree() || b.isFree() ) )
	{
		float a2bX = a.position().x - b.position().x;
		float a2bY = a.position().y - b.position().y;
		float a2bZ = a.position().z - b.position().z;
		
		float a2bDistance = (float)Math.sqrt( a2bX*a2bX + a2bY*a2bY + a2bZ*a2bZ );

		// check if cable is slack
		if ( a2bDistance >= l0 ) {
			slack = false;
			
			a2bX /= a2bDistance;
			a2bY /= a2bDistance;
			a2bZ /= a2bDistance;
		
			// elastic force is proportional to how much it stretched 
			// t = EA/l0 * (l-l0) + t0  

			float elasticForce = 0;
			
			// if tension not fixed
			if (!fixTension)
				elasticForce = -( a2bDistance - l0 ) * E*A/l0 + t0;
			// if tension fixed prestress only
			else elasticForce = t0;


			a2bX *= elasticForce;
			a2bY *= elasticForce;
			a2bZ *= elasticForce;

			if ( a.isFree() )
				a.force().add( a2bX, a2bY, a2bZ );

			// forceB is same as forceA in opposite direction
			if ( b.isFree() )
				b.force().add( -a2bX, -a2bY, -a2bZ );
		}
		else {
			slack = true;
		}
		
	}
  }

}



public class Bending extends Force
{
	Particle a;
	Particle b;
	Particle c;
	float EI;
	float ES;
	float L0ab,L0bc;

	public Bending( Particle a, Particle b, Particle c, float L0ab, float L0bc, float E, float S, float I ) {
		this.a = a;
		this.b = b;
		this.c = c;
		on = true;
		EI = E*I;
		ES = E*S;
		// compute rest distances
		this.L0ab = L0ab;
		this.L0bc = L0bc;
	}

	
	
	public Bending( Particle a, Particle b, Particle c, float E, float S, float I )	{
		this(a,b,c,a.distanceTo(b),b.distanceTo(c),E,I,S);
	}

	protected void setA( Particle p ) { a = p;}
	protected void setB( Particle p ) {	b = p;}
	protected void setC( Particle p ) {	c = p;}

	public final Particle getOneEnd(){return a;}
	public final Particle getTheMiddle(){return b;}
	public final Particle getTheOtherEnd(){return c;}

	public final void setEI( float E, float I )	{this.EI = E*I;}
	public final void setES( float E, float S )	{this.ES = E*S;}




	public void apply()
	{
		if ( on && ( a.isFree() || b.isFree() || c.isFree()) )
		{
			// compute current distances
			float Lab = a.distanceTo(b);
			float Lbc = b.distanceTo(c);
			float Lac = a.distanceTo(c);

			// compute direction vectors
			Vector3D ab = new Vector3D(b.position());
			ab.subtract(a.position());

			Vector3D bc = new Vector3D(c.position());
			bc.subtract(b.position());
			
			// compute tension
			Vector3D Tab = new Vector3D(ab).multiplyBy(ES*(1f/L0ab - 1f/Lab));
			Vector3D Tbc = new Vector3D(bc).multiplyBy(ES*(1f/L0bc - 1f/Lbc));
						
			// compute moment
			Vector3D Mb, Fab, Fbc;
			if (a.position().distanceLineSq(b.position(),c.position()) > 10e-8) {
		      Mb = ab.cross(bc).multiplyBy(2*EI/(Lac*Lab*Lbc));
			  Fab = ab.cross(Mb).multiplyBy(1/(Lab*Lab));
			  Fbc = bc.cross(Mb).multiplyBy(1/(Lbc*Lbc));
			}
			else {
			   Fab = new Vector3D();
			   Fbc = new Vector3D();
			}
			
			// apply
						
			if ( a.isFree() ) {
				a.force().add( Tab);
				a.force().add( Fab);
			}
			if ( b.isFree() ) {
				b.force().add( new Vector3D(Tab).inv() );
				b.force().add( Tbc );
				
				b.force().add( new Vector3D(Fab).inv() );
				b.force().add( new Vector3D(Fbc).inv() );
			}
			if ( c.isFree()) {
				c.force().add( new Vector3D(Tbc).inv());
				c.force().add( Fbc);
			}
		}
	}

	
	
}


public class Attraction extends Force
{
	Particle a;
	Particle b;
	float k;
	float distanceMin;
	float distanceMinSquared;
	
	public Attraction( Particle a, Particle b, float k, float distanceMin )
	{
		this.a = a;
		this.b = b;
		this.k = k;
		on = true;
		this.distanceMin = distanceMin;
		this.distanceMinSquared = distanceMin*distanceMin;
	}

	protected void setA( Particle p )
	{
		a = p;
	}

	protected void setB( Particle p )
	{
		b = p;
	}

	public final float getMinimumDistance()
	{
		return distanceMin;
	}

	public final void setMinimumDistance( float d )
	{
		distanceMin = d;
		distanceMinSquared = d*d;
	}


	public final void setStrength( float k )
	{
		this.k = k;
	}

	public final Particle getOneEnd()
	{
		return a;
	}

	public final Particle getTheOtherEnd()
	{
		return b;
	}

	public void apply()
	{
		if ( on && ( a.isFree() || b.isFree() ) )
		{
			float a2bX = a.position().x() - b.position().x();
			float a2bY = a.position().y() - b.position().y();
			float a2bZ = a.position().z() - b.position().z();

			float a2bDistanceSquared = a2bX*a2bX + a2bY*a2bY + a2bZ*a2bZ;

			if ( a2bDistanceSquared < distanceMinSquared )
				a2bDistanceSquared = distanceMinSquared;

			float force = k * a.massAverage() * b.massAverage() / a2bDistanceSquared;

			float length = (float)Math.sqrt( a2bDistanceSquared );
			
			// make unit vector
			
			a2bX /= length;
			a2bY /= length;
			a2bZ /= length;
			
			// multiply by force 
			
			a2bX *= force;
			a2bY *= force;
			a2bZ *= force;

			// apply
			
			if ( a.isFree() )
				a.force().add( -a2bX, -a2bY, -a2bZ );
			if ( b.isFree() )
				b.force().add( a2bX, a2bY, a2bZ );
		}
	}

	public final float getStrength()
	{
		return k;
	}


}

#@@@@@@@@@@@@@@@@@@@@@@@@@@@@@@@
#@@@@@@@@@@@@@@@@@@@@@@@@@@@@@@@
#@@@@@@@@@@@@@@@@@@@@@@@@@@@@@@@
#@@@@@@@@@@@@@@@@@@@@@@@@@@@@@@@

if reset:
    pts = []
    for i in range(0,subDiv+1):
        crvPt = Rhino.Geometry.Curve.PointAt(curveIn, curveIn.Domain[1]/subDiv * i)
        pts.append(crvPt)
        
#the below is complete nonsense. Just a placeholder for some sort of simulation

center = Rhino.Geometry.Point3d((supportPtsIn[0].X + supportPtsIn[1].X) * .5, (supportPtsIn[0].Y + supportPtsIn[1].Y) * .5, (supportPtsIn[0].Z + supportPtsIn[1].Z) * .5)

for i in range(1,subDiv):
    towards = Rhino.Geometry.Vector3d(center.X - pts[i].X, center.Y - pts[i].Y, center.Z - pts[i].Z)
    towards = Rhino.Geometry.Vector3d.Multiply(.01, towards)
    pts[i] = Rhino.Geometry.Point3d.Add(pts[i], towards)
        
curveOut = Rhino.Geometry.PolylineCurve(pts)
  
curvePoints = pts
# ---------- end dynamic_relaxation_engine ----------
pt_2 = Point(dynamic_relaxation_engine.curvePoints)
crv_2 = Curve(dynamic_relaxation_engine.curveOut)
