# Grasshopper definition ExampleFileForJulien.gh (Grasshopper 0.9.61)
# plug-ins: Python Interpreter

subdiv = Slider(10, range=0..24)
pt = Point([Point(0, 0, 0), Point(15, 0, 0)])
# This is some geometry from Rhino
crv = Curve(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)
timer = Timer(TimerInterval=200, Target=python_example)
# The names you give the input/output parameters, are accessible within the script (you do not need to declare anything)
# Also, if you right click an input parameter you can tell python what type of variable it is using the 'type hint' in the bottom
run = BooleanToggle(True)
reset = BooleanToggle(True)
python_example = PythonScript(curveIn=crv, supportPtsIn=pt, subDiv=subdiv, run=run, reset=reset)  # -> out, curveOut, curvePoints; inputs curveIn: Curve, supportPtsIn: list of Point3d, subDiv: Int32
# ---------- python_example: Python ----------
import Rhino # this is all the Rhino common classes and stuff (documentation here: http://4.rhino3d.com/5/rhinocommon/)
import sys

"""This example is to show how I would set up a simulation type of script.

In a sense I think of it sort of like Processing's setup and draw structure, 
where one part of the sript initialises the code and another continously
make changes. The thing is; the variables do not need to be initialised every
time the script is triggered."""

print sys.path

if reset:
    pts = []
    for i in range(0,subDiv+1):
        crvPt = Rhino.Geometry.Curve.PointAt(curveIn, curveIn.Domain[1]/subDiv * i)
        pts.append(crvPt)
        
#the below is complete nonsense. Just a placeholder for some sort of simulation

center = Rhino.Geometry.Point3d((supportPtsIn[0].X + supportPtsIn[1].X) * .5, (supportPtsIn[0].Y + supportPtsIn[1].Y) * .5, (supportPtsIn[0].Z + supportPtsIn[1].Z) * .5)

for i in range(1,subDiv):
    towards = Rhino.Geometry.Vector3d(center.X - pts[i].X, center.Y - pts[i].Y, center.Z - pts[i].Z)
    towards = Rhino.Geometry.Vector3d.Multiply(.01, towards)
    pts[i] = Rhino.Geometry.Point3d.Add(pts[i], towards)
        
curveOut = Rhino.Geometry.PolylineCurve(pts)
  
curvePoints = pts
# ---------- end python_example ----------
pt_2 = Point(python_example.curvePoints)
crv_2 = Curve(python_example.curveOut)
