# Grasshopper definition component_multiple_mt.ghx (Grasshopper 0.6.59)

# Multiple components instantiated on a surface, reacting to 2 attractor points
# Subdivide Surface
panel = Panel("")
# Cutting Pattern
panel_2 = Panel("")
# Distance to Attractor Points
panel_3 = Panel("")
# Bending Graph
panel_4 = Panel("")
# false colour feedback
panel_5 = Panel("")
crv = Curve(<curve referenced from the Rhino model>)
crv_2 = Curve(<curve referenced from the Rhino model>)
crv_3 = Curve(<curve referenced from the Rhino model>)
crv_4 = Curve(<curve referenced from the Rhino model>)
pt = Point(<point referenced from the Rhino model>)
bend_graph = Curve(<curve referenced from the Rhino model>)
straight_bottom_line = Curve(<curve referenced from the Rhino model>)
tensile_size = Curve(<curve referenced from the Rhino model>)
# these are the dimensions
# of the component
# this section divides an input surface
# into a checkerboard of points
panel_6 = Panel("7.5")
attractor_point_1 = Point(<point referenced from the Rhino model>)
attractor_point_2 = Point(<point referenced from the Rhino model>)
srf = Surface(<surface referenced from the Rhino model>)
Y = UnitY(F="5")
center_pt = Point(<point referenced from the Rhino model>)
dim = Dimensions(S=srf)  # -> U, V
Y_2 = UnitY(F=1)
div = Division(A=dim.V, B=panel_6)
div_2 = Division(A=dim.U, B="14")
sframes = SurfaceFrames(S=srf, U=div_2, V=div)  # -> F, uv
series = Series(S=0, N=expr("(N+1)*2", div), C=expr("(C/2)+1", div_2))
rev = Reverse(V=Y)
add = Addition(A=div, B=expr("B+2", series))
move = Move(G=center_pt, T=Y)
move_2 = Move(G=center_pt, T=rev)
X = UnitX(F=".125")
Y_3 = UnitY(F="1.1")
x_axis_plane = Plane(O=center_pt, X=Vector(0, 0, 1), Y=Vector(1, 0, 0))
y_axis_plane = Plane(O=center_pt, X=Vector(0, 0, 1), Y=Vector(0, 1, 0))
Y_4 = UnitY(F=expr("-f", "-2"))
series_2 = Series(S=add, N=2, C=expr("(C/2)", div))
series_3 = Series(S=series, N=2, C=expr("(C/2)+1", div))
flatten = FlattenTree(D=sframes.F, P="{0}")
flatten_2 = FlattenTree(D=series_3, P="{0}")
flatten_3 = FlattenTree(D=series_2, P="{0}")
cull_i = CullIndex(L=flatten, I=[flatten_2, flatten_3])
move_3 = Move(G=move, T=Y_4)
move_4 = Move(G=[move, move_2], T=X)
move_5 = Move(G=move, T=Y_3)
mirror = Mirror(G=move_5, P=x_axis_plane)
mirror_2 = Mirror(G=move_4, P=y_axis_plane)
ln = Line(A=move, B=move_2)
mirror_3 = Mirror(G=move_3, P=x_axis_plane)
simplify = SimplifyTree(T=cull_i)
receiver = Receiver(simplify, DrawTag=True, DrawWires=1)
dist = Distance(A=receiver, B=attractor_point_1)
dist_2 = Distance(A=receiver, B=attractor_point_2)
smaller = SmallerThan(A=dist, B=dist_2)  # -> port, port_2
dispatch = Dispatch(L=dist, P=smaller.port)  # -> A, B
dispatch_2 = Dispatch(L=dist_2, P=smaller.port)  # -> A, B
weave = Weave(P=smaller.port, _0=dispatch_2.B, _1=dispatch.A, NullGaps=False)
bnd = Bounds(N=weave)
domcomp = DomainComponents(I=bnd)  # -> S, E
minus = Subtraction(A=weave, B=domcomp.S)
bnd_2 = Bounds(N=minus)
domcomp_2 = DomainComponents(I=bnd_2)  # -> S, E
ln_2 = Line(A=move_4, B=mirror_2)
ln_3 = Line(A=mirror, B=mirror_3)
ln_4 = Line(A=move_5, B=move_3)
div_3 = Division(A=minus, B=domcomp_2.E)
panel_7 = Panel(div_3)
# Don't Rationalise Components
panel_8 = Panel("")
# Rationalise Components
panel_9 = Panel("")
vb = DotNETVBScript(y=panel_7)  # -> out, A
# ---------- vb: VB ----------
    If  y > 0.0 Then
      A = 0.2
    End If
    If  y > 0.2 Then
      A = 0.4
    End If
    If  y > 0.4 Then
      A = 0.6
    End If
    If  y > 0.6 Then
      A = 0.8
    End If
    If  y > 0.8 Then
      A = 1.0
    End If
# ---------- end vb ----------
panel_10 = Panel(vb.A)
panel_11 = Panel(panel_7)
pln = Plane(simplify)
points = PointList(P=pln, T=True, L=True, S=Slider(2.250061035, range=0..100))
# Component Geometry
# this section sets up the
# component construction geometry,
# (the pts and crvs that we need
# to define the component)
# and outputs a surface
panel_12 = Panel("")
graft = GraftTree(D=pln, S=False)
flatten_4 = FlattenTree(D=panel_10, P="{0}")
flatten_5 = FlattenTree(D=panel_11, P="{0}")
graft_2 = GraftTree(D=flatten_4, S=False)
graft_3 = GraftTree(D=flatten_5, S=False)
# inputs
pln_2 = Plane(graft)
# Instanciated Cutting Pattern
panel_13 = Panel("")
receiver_2 = Receiver(simplify, DrawTag=True, DrawWires=1)
lng = ListLength(L=receiver_2)
pcomp = PlaneComponents(P=pln_2)  # -> O, X, Y, Z
# this boolean gate flips between
# rationalised (true) and non-rationalised
# (false) component geomtry
toggle = BooleanToggle(True)
item = ListItem(L=ln_2, i=1, W=False)
_3d_rotation_1 = Rotate3D(G=pln_2, A=Slider(0, range=-1..1), C=pcomp.O, X=pcomp.X)
X_2 = UnitX(F=1)
series_4 = Series(S=0, N=40, C=lng)
filter = StreamFilter(G=toggle, _0=graft_2, _1=graft_3)
receiver_3 = Receiver(filter, DrawTag=True, DrawWires=1)
# input colour values
receiver_4 = Receiver(filter, DrawTag=True, DrawWires=1)
receiver_5 = Receiver(filter, DrawTag=True, DrawWires=1)
gradient = Gradient(L0="0", L1="1", t=receiver_4, stops=[0: None, 0: None, 0: None, 0: None, 0: None])
eval = EvaluateLength(C=straight_bottom_line, L=receiver_3, N=True)  # -> P, T, t
line = LineSDL(S=eval.P, D=Y_2, L="20")
shader = CreateShader(Kd=gradient, Ks=RGB(255, 255, 255), Ke=RGB(0, 0, 0), T=0, S=0)
clx = CurveLine(C=bend_graph, L=line, Lf=False)  # -> P, t, E
clx_2 = CurveLine(C=tensile_size, L=line, Lf=False)  # -> P, t, E
# this section takes the input graphs
# that define bending behaviour and
# outputs intersection points.
# The y values of these points are fed
# into the component to control its movement
pcomp_2 = Decompose(P=clx_2.P)  # -> X, Y, Z
receiver_6 = Receiver(pcomp_2.Y, DrawTag=True, DrawWires=1)
num = Number(receiver_6)
X_3 = UnitX(F=num)
rev_2 = Reverse(V=X_3)
move_6 = Move(G=center_pt, T=X_3)
move_7 = Move(G=center_pt, T=rev_2)
pcomp_3 = Decompose(P=flatten(clx.P))  # -> X, Y, Z
pt_steelstick = LineSDL(S=move_7, D=X_3, L=".025")
circle = CircleCNR(C=[move_6, move_7], N=Vector(0, 0, 1), R=".25")
ln_5 = Line(A=move_6, B=move_7)
eval_2 = EvaluateLength(C=crv, L=receiver_5, N=True)  # -> P, T, t
eval_3 = EvaluateLength(C=crv_2, L=receiver_5, N=True)  # -> P, T, t
eval_4 = EvaluateLength(C=crv_3, L=receiver_5, N=True)  # -> P, T, t
eval_5 = EvaluateLength(C=crv_4, L=receiver_5, N=True)  # -> P, T, t
pt_steelstick_2 = LineSDL(S=move_6, D=X_3, L=".025")
weave_2 = Weave(P=[0, 1, 2, 3, 4], _0=pt, _1=eval_2.P, _2=eval_3.P, _3=eval_4.P, _4=eval_5.P, NullGaps=False)
crv_5 = Curve(V=weave_2, D=3, P=False)  # -> C, L, D
mirror_4 = Mirror(G=crv_5.C, P=x_axis_plane)
mirror_5 = Mirror(G=[mirror_4, crv_5.C], P=y_axis_plane)
cut_lines_weave = Weave(P=[0, 1, 2, 3, 4], _0=ln_4, _1=ln_3, _2=ln_2, _3=pt_steelstick_2, _4=pt_steelstick, NullGaps=False)
ingrave_lines = JoinCurves(C=[circle, ln, ln_5], P=False)  # disabled
cut_curveline = JoinCurves(C=[mirror_4, crv_5.C, mirror_5], P=False)
pcomp_4 = PlaneComponents(P=_3d_rotation_1)  # -> O, X, Y, Z
amp = Amplitude(V=X_2, A=series_4)
move_8 = Move(G=item, T=amp)
series_5 = Series(S=0, N=1, C=lng)
cp = ControlPoints(C=move_8)  # -> P, W
_3d_rotation_2 = Rotate3D(G=_3d_rotation_1, A=Slider(0, range=-1..1), C=pcomp_4.O, X=pcomp_4.Y)
dim_2 = Dimensions(S=cut_curveline)  # -> U, V
graft_4 = GraftTree(D=amp, S=False)
item_2 = ListItem(L=cp.P, i=1, W=False)
graft_5 = GraftTree(D=series_5, S=False)
move_9 = Move(G=item_2, T=[Vector(-2, -1.8, 0), Vector(-4.2, -1.8, 0), Vector(0.5, -1.8, 0), Vector(1, -1.8, 0)])
weave_3 = Weave(P=[0, 1, 2, 3], _2="#", _3=graft_5, NullGaps=False)
pcomp_5 = PlaneComponents(P=_3d_rotation_2)  # -> O, X, Y, Z
receiver_7 = Receiver(pcomp_3.Y, DrawTag=True, DrawWires=1)
receiver_8 = Receiver(pcomp_3.X, DrawTag=True, DrawWires=1)
pcomp_6 = PlaneComponents(P=_3d_rotation_2)  # -> O, X, Y, Z
pcomp_7 = PlaneComponents(P=_3d_rotation_2)  # -> O, X, Y, Z
# This component generates a cutting
# pattern from the component's fabric
# surface. The hard coding is based on
# knowledge gained during a previous
# workshop
move_10 = Move(G=cut_lines_weave, T=graft_4)
move_11 = Move(G=cut_curveline, T=graft_4)
tag = TextTag3D(L=move_9, T=weave_3, S=0.4)
graft_6 = GraftTree(D=receiver_7, S=False)
graft_7 = GraftTree(D=receiver_8, S=False)
amp_y = Amplitude(V=pcomp_5.Y, A="3.5")
move_12 = Move(G=_3d_rotation_2, T=amp_y)
y_axis_plane_2 = Plane(O=pcomp_6.O, X=pcomp_6.Y, Y=pcomp_6.Z)
circle_2 = CircleCNR(C=pcomp_7.O, N=pcomp_7.Z, R=7.5)
line_2 = LineSDL(S=pcomp_7.O, D=pcomp_7.Y, L=100)
x_axis_plane_2 = Plane(O=pcomp_6.O, X=pcomp_6.X, Y=pcomp_6.Z)
amp_2 = Amplitude(V=pcomp_5.Z, A=graft_6)
amp_3 = Amplitude(V=pcomp_5.X, A=graft_7)
int_pt_on_cirlce = CurveCurve(A=circle_2, B=line_2)  # -> P, tA, tB
move_13 = Move(G=pcomp_5.O, T=amp_2)
amp_x = Amplitude(V=pcomp_5.X, A="-12.3")
move_14 = Move(G=move_13, T=amp_3)
move_15 = Move(G=move_12, T=amp_x)
mirror_6 = Mirror(G=move_14, P=y_axis_plane_2)
amp_z = Amplitude(V=pcomp_5.Z, A="2.23")
mirror_7 = Mirror(G=mirror_6, P=_3d_rotation_2)
move_16 = Move(G=move_15, T=amp_z)
mirror_8 = Mirror(G=move_16, P=y_axis_plane_2)
mirror_9 = Mirror(G=mirror_8, P=_3d_rotation_2)
weave_4 = Weave(P=[0, 1, 2, 3, 4], _0=move_14, _1=move_16, _2=int_pt_on_cirlce.P, _3=mirror_9, _4=mirror_7, NullGaps=False)
simplify_2 = SimplifyTree(T=weave_4)
loft_crv_1 = Interpolate(V=simplify_2, D=3, P=False)  # -> C, L, D
straight_line = Line(A=move_14, B=mirror_7)
loft_crv_2 = Mirror(G=flatten(loft_crv_1.C), P=flatten(x_axis_plane_2))
graft_8 = GraftTree(D=flatten(loft_crv_1.C), S=False)
graft_9 = GraftTree(D=flatten(straight_line), S=False)
# output: surface geometry
graft_10 = GraftTree(D=flatten(loft_crv_2), S=False)
m3 = Merge03(A=graft_10, B=graft_9, C=graft_8)
loft = Loft(S=m3, O={Adjust=False, Closed=False, Rebuild=10, Refit=0.01, LoftType=0, LoftEnds=3, LoftSimp=0})
# input geometry to colour
receiver_9 = Receiver(loft, DrawTag=True, DrawWires=1)
preview = CustomPreview(G=receiver_9, S=shader)
