# Grasshopper definition component_Single.ghx (Grasshopper 0.6.59)

pln = Plane(PlaneXY(20, 0, 0))
# this section firstly controls the base
# point and 3D rotation of the component.
# It then sets up the construction geometry,
# (the pts and crvs that we need
# to define the component)
# and outputs a surface
# Component Geometry
panel = Panel("")
# This component generates a cutting
# pattern from the component's fabric
# surface. The hard coding is based on
# knowledge gained during a previous
# workshop
panel_2 = Panel("")
# false colour feedback
panel_3 = Panel("")
# Bending Graph
panel_4 = Panel("")
graft = GraftTree(D=pln, S=False)
slider = Slider(1, range=0..1)
bend_graph = Curve(<curve referenced from the Rhino model>)
straight_bottom_line = Curve(<curve referenced from the Rhino model>)
# input colour values
receiver = Receiver(slider, DrawTag=True, DrawWires=1)
tensile_size = Curve(<curve referenced from the Rhino model>)
crv = Curve(<curve referenced from the Rhino model>)
crv_2 = Curve(<curve referenced from the Rhino model>)
receiver_2 = Receiver(slider, DrawTag=True, DrawWires=1)
crv_3 = Curve(<curve referenced from the Rhino model>)
crv_4 = Curve(<curve referenced from the Rhino model>)
pt = Point(<point referenced from the Rhino model>)
# inputs
pln_2 = Plane(graft)
gradient = Gradient(L0="0", L1="1", t=receiver, stops=[0: None, 0: None, 0: None, 0: None, 0: None])
eval = EvaluateLength(C=straight_bottom_line, L=slider, N=slider)  # -> P, T, t
center_pt = Point(<point referenced from the Rhino model>)
Y = UnitY(F="5")
pcomp = PlaneComponents(P=pln_2)  # -> O, X, Y, Z
Y_2 = UnitY(F=1)
_3d_rotation_1 = Rotate3D(G=pln_2, A=Slider(0, range=-1..1), C=pcomp.O, X=pcomp.X)
line = LineSDL(S=eval.P, D=Y_2, L="20")
shader = CreateShader(Kd=gradient, Ks=RGB(255, 255, 255), Ke=RGB(0, 0, 0), T=0, S=0)
pcomp_2 = PlaneComponents(P=_3d_rotation_1)  # -> O, X, Y, Z
clx = CurveLine(C=bend_graph, L=line, Lf=False)  # -> P, t, E
clx_2 = CurveLine(C=tensile_size, L=line, Lf=False)  # -> P, t, E
rev = Reverse(V=Y)
_3d_rotation_2 = Rotate3D(G=_3d_rotation_1, A=Slider(0, range=-1..1), C=pcomp_2.O, X=pcomp_2.Y)
move = Move(G=center_pt, T=Y)
move_2 = Move(G=center_pt, T=rev)
X = UnitX(F=".125")
Y_3 = UnitY(F="1.1")
x_axis_plane = Plane(O=center_pt, X=Vector(0, 0, 1), Y=Vector(1, 0, 0))
y_axis_plane = Plane(O=center_pt, X=Vector(0, 0, 1), Y=Vector(0, 1, 0))
Y_4 = UnitY(F=expr("-f", "-2"))
pcomp_3 = Decompose(P=clx_2.P)  # -> X, Y, Z
receiver_3 = Receiver(pcomp_3.Y, DrawTag=True, DrawWires=1)
num = Number(receiver_3)
X_2 = UnitX(F=num)
rev_2 = Reverse(V=X_2)
move_3 = Move(G=center_pt, T=X_2)
move_4 = Move(G=center_pt, T=rev_2)
pcomp_4 = Decompose(P=flatten(clx.P))  # -> X, Y, Z
pcomp_5 = PlaneComponents(P=_3d_rotation_2)  # -> O, X, Y, Z
receiver_4 = Receiver(pcomp_4.Y, DrawTag=True, DrawWires=1)
receiver_5 = Receiver(pcomp_4.X, DrawTag=True, DrawWires=1)
pcomp_6 = PlaneComponents(P=_3d_rotation_2)  # -> O, X, Y, Z
pcomp_7 = PlaneComponents(P=_3d_rotation_2)  # -> O, X, Y, Z
move_5 = Move(G=move, T=Y_4)
move_6 = Move(G=[move, move_2], T=X)
pt_steelstick = LineSDL(S=move_3, D=X_2, L=".025")
move_7 = Move(G=move, T=Y_3)
mirror = Mirror(G=move_7, P=x_axis_plane)
mirror_2 = Mirror(G=move_6, P=y_axis_plane)
ln = Line(A=move, B=move_2)
circle = CircleCNR(C=[move_3, move_4], N=Vector(0, 0, 1), R=".25")
ln_2 = Line(A=move_3, B=move_4)
mirror_3 = Mirror(G=move_5, P=x_axis_plane)
pt_steelstick_2 = LineSDL(S=move_4, D=X_2, L=".025")
eval_2 = EvaluateLength(C=crv, L=receiver_2, N=True)  # -> P, T, t
eval_3 = EvaluateLength(C=crv_2, L=receiver_2, N=True)  # -> P, T, t
eval_4 = EvaluateLength(C=crv_3, L=receiver_2, N=True)  # -> P, T, t
eval_5 = EvaluateLength(C=crv_4, L=receiver_2, N=True)  # -> P, T, t
graft_2 = GraftTree(D=receiver_4, S=False)
graft_3 = GraftTree(D=receiver_5, S=False)
amp_y = Amplitude(V=pcomp_5.Y, A="3.5")
move_8 = Move(G=_3d_rotation_2, T=amp_y)
y_axis_plane_2 = Plane(O=pcomp_6.O, X=pcomp_6.Y, Y=pcomp_6.Z)
ln_3 = Line(A=move_6, B=mirror_2)
ln_4 = Line(A=mirror, B=mirror_3)
circle_2 = CircleCNR(C=pcomp_7.O, N=pcomp_7.Z, R=7.5)
line_2 = LineSDL(S=pcomp_7.O, D=pcomp_7.Y, L=100)
x_axis_plane_2 = Plane(O=pcomp_6.O, X=pcomp_6.X, Y=pcomp_6.Z)
ln_5 = Line(A=move_7, B=move_5)
amp = Amplitude(V=pcomp_5.Z, A=graft_2)
amp_2 = Amplitude(V=pcomp_5.X, A=graft_3)
weave = Weave(P=[0, 1, 2, 3, 4], _0=pt, _1=eval_2.P, _2=eval_3.P, _3=eval_4.P, _4=eval_5.P, NullGaps=False)
int_pt_on_cirlce = CurveCurve(A=circle_2, B=line_2)  # -> P, tA, tB
move_9 = Move(G=pcomp_5.O, T=amp)
len = Length(C=circle_2)
amp_x = Amplitude(V=pcomp_5.X, A="-12.3")
crv_5 = Curve(V=weave, D=3, P=False)  # -> C, L, D
mirror_4 = Mirror(G=crv_5.C, P=x_axis_plane)
mirror_5 = Mirror(G=[mirror_4, crv_5.C], P=y_axis_plane)
move_10 = Move(G=move_9, T=amp_2)
move_11 = Move(G=move_8, T=amp_x)
circle_length_cm = Panel(len)
mirror_6 = Mirror(G=move_10, P=y_axis_plane_2)
cut_lines = JoinCurves(C=[ln_5, ln_4, ln_3, pt_steelstick, pt_steelstick_2], P=False)
amp_z = Amplitude(V=pcomp_5.Z, A="2.23")
mirror_7 = Mirror(G=mirror_6, P=_3d_rotation_2)
move_12 = Move(G=move_11, T=amp_z)
mirror_8 = Mirror(G=move_12, P=y_axis_plane_2)
ingrave_lines = JoinCurves(C=[circle, ln, ln_2], P=False)  # disabled
cut_curveline = JoinCurves(C=[mirror_4, crv_5.C, mirror_5], P=False)
mirror_9 = Mirror(G=mirror_8, P=_3d_rotation_2)
weave_2 = Weave(P=[0, 1, 2, 3, 4], _0=move_10, _1=move_12, _2=int_pt_on_cirlce.P, _3=mirror_9, _4=mirror_7, NullGaps=False)
simplify = SimplifyTree(T=weave_2)
panel_5 = Panel("")  # disabled
X_3 = UnitX(F=1)
item = ListItem(L=ln_3, i=1, W=False)
loft_crv_1 = Interpolate(V=simplify, D=3, P=False)  # -> C, L, D
amp_3 = Amplitude(V=X_3, A=-0.5)
straight_line = Line(A=move_10, B=mirror_7)
loft_crv_2_mirrored = Mirror(G=flatten(loft_crv_1.C), P=flatten(x_axis_plane_2))
move_13 = Move(G=item, T=amp_3)
graft_4 = GraftTree(D=flatten(loft_crv_1.C), S=False)
graft_5 = GraftTree(D=flatten(straight_line), S=False)
# output: surface geometry
graft_6 = GraftTree(D=flatten(loft_crv_2_mirrored), S=False)
cp = ControlPoints(C=move_13)  # -> P, W
len_2 = Length(C=graft_6)
m3 = Merge03(A=graft_6, B=graft_5, C=graft_4)
item_2 = ListItem(L=cp.P, i=1, W=False)
loft = Loft(S=m3, O={Adjust=False, Closed=False, Rebuild=10, Refit=0.01, LoftType=0, LoftEnds=3, LoftSimp=0})
# input geometry to colour
receiver_6 = Receiver(loft, DrawTag=True, DrawWires=1)
preview = CustomPreview(G=receiver_6, S=shader)
length_curves_cm = Panel(len_2)
dim = Dimensions(S=cut_curveline)  # -> U, V
move_14 = Move(G=item_2, T=[Vector(-2, -1.8, 0), Vector(-4.2, -1.8, 0)])
tag = TextTag3D(L=move_14, T=[dim.U, dim.V], S=0.4)
