# Grasshopper definition materials_example.gh (Grasshopper 0.9.61)

second_moment_of_area = Slider(0.25, range=0..1)
second_moment_of_area_2 = Slider(0.25, range=0..1)
second_moment_of_area_3 = Slider(0.25, range=0..1)
e_value = Slider(0.25, range=0..1)
e_value_2 = Slider(0.25, range=0..1)
e_value_3 = Slider(0.25, range=0..1)
etc = Slider(0.25, range=0..1)
etc_2 = Slider(0.25, range=0..1)
etc_3 = Slider(0.25, range=0..1)
panel = Panel(["MATERIAL TWO", e_value, second_moment_of_area, etc])
panel_2 = Panel(["MATERIAL THREE", e_value_2, second_moment_of_area_2, etc_2])
panel_3 = Panel(["MATERIAL ONE", e_value_3, second_moment_of_area_3, etc_3])
path_mapper = PathMapper(panel_3, source="{0}", target="{0}")
path_mapper_2 = PathMapper(panel_2, source="{0}", target="{2}")
path_mapper_3 = PathMapper(panel, source="{0}", target="{1}")
panel_4 = Panel([path_mapper, path_mapper_3, path_mapper_2])
